# Dynamo graph 2020_08_19-Exterierova_obalka.dyn (Dynamo 2.0.3.8810)

exclude_elements = DSModelElementsSelection()  # 18 picked in the model
getRTD_model = Python(IN[0]=exclude_elements)
# ---------- getRTD_model.python (29 lines) ----------
# -*- coding: utf-8 -*-
# Copyright(c) 2020, Daniel Gercak
#Script for selecting and grouping elements by levels and other parameters for dynamo 
#resource_path: H:\_WORK\PYTHON\REVIT_API\getRTD_model.py

import sys
pyt_path = r'C:\Program Files (x86)\IronPython 2.7\Lib'
lib_path = r'H:\_WORK\PYTHON\REVIT_API\LIB'
sys.path.append(pyt_path)
sys.path.append(lib_path)

# from itertools import chain, groupby
# from RevitSelection import *
# import RevitSelection as RevitSelection
# from ListUtils import *
# import ListUtils as ListUtils

from Analyse import *
from AnalyseForm import *
from Errors import *

rtdObject = RTD_model(doc, IN[0])

if Errors.hasError():
 	OUT = Errors.report
# elif Errors.hasContent():
# 	OUT = Errors.getConntainerContent()
else:
	OUT = rtdObject
# ----------------------------------------
getEnergyAnalyses = Python(IN[0]=getRTD_model)
# ---------- getEnergyAnalyses.python (45 lines) ----------
# -*- coding: utf-8 -*-
# Copyright(c) 2020, Daniel Gercak
#Script for selecting and grouping elements by levels and other parameters for dynamo 
#resource_path: H:\_WORK\PYTHON\REVIT_API\getEnergyAnalyses.py

import sys
pyt_path = r'C:\Program Files (x86)\IronPython 2.7\Lib'
lib_path = r'H:\_WORK\PYTHON\REVIT_API\LIB'
sys.path.append(pyt_path)
sys.path.append(lib_path)

from Analyse import *
from AnalyseForm import *
from Errors import *

clr.AddReference("System.Windows.Forms")
clr.AddReference("System.Drawing")
import System.Drawing
import System.Windows.Forms
from System.Drawing import *
from System.Windows.Forms import Application, Button, Form, ComboBox, Label, TextBox, DockStyle, AnchorStyles, FormBorderStyle



energyAnalyseObject = EnAnalyse(doc, IN[0])
#Errors.catchVar(energyAnalyseObject.quantities, "energyAnalyseObject.quantities", front=True )

# <Run the form window
Application.EnableVisualStyles()
appWindow = MainForm(energyAnalyseObject)
appWindow.FormBorderStyle = FormBorderStyle.FixedSingle
appWindow.TopMost = True
appWindow.BackColor = Color.White


Application.Run(appWindow)

myOutput = "Vážení pŕátelé ANO"

if Errors.hasError():
 	OUT = Errors.report
elif Errors.hasContent():
 	OUT = Errors.getConntainerContent()
else:
	OUT = myOutput
# ----------------------------------------

# group: OUTERSHELLS
string = StringInput("""rtdModel = IN[0]
OUT = rtdModel.outerShells""")
outerShells = PythonStringNode(script=string, IN[0]=getRTD_model)  # "rtdModel.outerShells"
code_block = CodeBlock(obj=outerShells) { obj[0]; }

# group: cutting cube
byGeometry = BoundingBox.ByGeometry(geom=code_block)
minPoint = BoundingBox.MinPoint(boundingBox=byGeometry)
maxPoint = BoundingBox.MaxPoint(boundingBox=byGeometry)
xmin_offset = DoubleSlider(0, range=0..1 step 0.01)
xmax_offset = DoubleSlider(0, range=0..1 step 0.01)
ymin_offset = DoubleSlider(0, range=0..1 step 0.01)
ymax_offset = DoubleSlider(0, range=0..1 step 0.01)
code_block_2 = CodeBlock(inPointMin=minPoint, inPointMax=maxPoint, xMinOffset=xmin_offset, xMaxOffset=xmax_offset, yMinOffset=ymin_offset, yMaxOffset=ymax_offset)
# ---------- code_block_2.designscript (12 lines) ----------
inPointMin.X;
inPointMin.Y;
inPointMin.Z;
inPointMax.X;
inPointMax.Y;
inPointMax.Z;
xLength=inPointMax.X - inPointMin.X;
newLengthX = xLength * (1-Math.Max(xMinOffset+xMaxOffset,1));
yLength=inPointMax.Y - inPointMin.Y;
newLengthY = yLength * (1-Math.Max(yMinOffset+yMaxOffset,1));
newPointMin = Point.ByCoordinates(inPointMin.X+xMinOffset*xLength, inPointMin.Y+yMinOffset*yLength , inPointMin.Z);
newPointMax = Point.ByCoordinates(inPointMax.X-xMaxOffset*xLength, inPointMax.Y-yMaxOffset*yLength , inPointMax.Z);
# ----------------------------------------
byCorners = BoundingBox.ByCorners(min=code_block_2.newPointMin, max=code_block_2.newPointMax)
toCuboid = BoundingBox.ToCuboid(boundingBox=byCorners)
intersect = Geometry.Intersect(geometry=code_block, other=toCuboid)
code_block_3 = CodeBlock { 100; }
code_block_4 = CodeBlock { 150; 255; 50; }
byARGB = Color.ByARGB(a=code_block_3, r=code_block_4.out0, g=code_block_4.out1, b=code_block_4.out2)
byGeometryColor = Modifiers.GeometryColor.ByGeometryColor(geometry=intersect, color=byARGB)
watch = Watch(code_block_2.xLength)
zmin_offset = DoubleSlider(0, range=0..1 step 0.01)
zmax_offset = DoubleSlider(0, range=0..1 step 0.01)

dir = Python(IN[0]=getRTD_model)
# ---------- dir.python (28 lines) ----------
# -*- coding: utf-8 -*-
# Copyright(c) 2020, Daniel Gercak
#Script for selecting and grouping elements by levels and other parameters for dynamo 
#resource_path: H:\_WORK\PYTHON\REVIT_API\getRTD_model.py

import sys
pyt_path = r'C:\Program Files (x86)\IronPython 2.7\Lib'
lib_path = r'H:\_WORK\PYTHON\REVIT_API\LIB'
sys.path.append(pyt_path)
sys.path.append(lib_path)


# from itertools import chain, groupby
# from RevitSelection import *
# import RevitSelection as RevitSelection
# from ListUtils import *
# import ListUtils as ListUtils

from Errors import *



if Errors.hasError():
 	OUT = Errors.report
# elif Errors.hasContent():
# 	OUT = Errors.getConntainerContent()
else:
	OUT = dir(IN[0])
# ----------------------------------------

# group: INNERSHELLS
string_2 = StringInput("""rtdModel = IN[0]
OUT = rtdModel.innerShells""")
innerShells = PythonStringNode(script=string_2, IN[0]=getRTD_model)  # "rtdModel.innerShells"
code_block_5 = CodeBlock(inSolids=innerShells) { inSolids[0]; }
volume = Solid.Volume(solid=code_block_5)
convert_between_units = DynamoConvert(volume, MeasurementType="Volume", FromConversion="CubicMillimeter", ToConversion="CubicMeters")
code_block_6 = CodeBlock { 0.005; }
gt = convert_between_units > code_block_6
filterByBoolMask = List.FilterByBoolMask(list=code_block_5, mask=gt)
integer_slider = IntegerSlider(0, range=0..13 step 1)
getItemAtIndex = List.GetItemAtIndex(list=filterByBoolMask.in, index=integer_slider)
bySolid = PolySurface.BySolid(solid=filterByBoolMask.in)
surfaces = PolySurface.Surfaces(polySurface=bySolid)
code_block_7 = CodeBlock { 0.5; }
normalAtParameter = Surface.NormalAtParameter(surface=surfaces, u=code_block_7, v=code_block_7)

# group: HORIZONTÁLNÍ PLOCHY - PODLAHY
Z = Vector.Z(vector=normalAtParameter)
code_block_8 = CodeBlock { -0.8; }
lt = Z < code_block_8
filterByBoolMask_2 = List.FilterByBoolMask(list=surfaces, mask=lt)
code_block_9 = CodeBlock(horizontal=filterByBoolMask_2.in) { horizontal; }
code_block_10 = CodeBlock { 255; }
code_block_11 = CodeBlock { 250; 0; 230; }

byARGB_2 = Color.ByARGB(a=code_block_10, r=code_block_11.out0, g=code_block_11.out1, b=code_block_11.out2)

# group (continued): HORIZONTÁLNÍ PLOCHY - PODLAHY
byGeometryColor_2 = Modifiers.GeometryColor.ByGeometryColor(geometry=code_block_9, color=byARGB_2)

code_block_12 = CodeBlock { 255; }

# group: VERTIKÁLNÍ PLOCHY
Z_2 = Vector.Z(vector=normalAtParameter)
code_block_13 = CodeBlock { 0; }
eq = Z_2 == code_block_13
filterByBoolMask_3 = List.FilterByBoolMask(list=surfaces, mask=eq)
code_block_14 = CodeBlock(vertical=filterByBoolMask_3.in) { vertical; }
code_block_15 = CodeBlock { 20; 0; 200; }
byARGB_3 = Color.ByARGB(a=code_block_12, r=code_block_15.out0, g=code_block_15.out1, b=code_block_15.out2)
byGeometryColor_3 = Modifiers.GeometryColor.ByGeometryColor(geometry=code_block_14, color=byARGB_3)

# group: OPENINGS
string_3 = StringInput("""rtdModel = IN[0]
OUT = rtdModel.subtractedOpenings""")
outerShells_2 = PythonStringNode(script=string_3, IN[0]=getRTD_model)  # "rtdModel.outerShells"
code_block_16 = CodeBlock { 255; }
code_block_17 = CodeBlock { 255; 0; 0; }
byARGB_4 = Color.ByARGB(a=code_block_16, r=code_block_17.out0, g=code_block_17.out1, b=code_block_17.out2)
byGeometryColor_4 = Modifiers.GeometryColor.ByGeometryColor(geometry=outerShells_2, color=byARGB_4)

# group: VERTIKALNI PLOCHY M2
area = Surface.Area(surface=code_block_14)
flatten = List.Flatten(list=area)
sum = Math.Sum(values=flatten)
convert_between_units_2 = DynamoConvert(sum, MeasurementType="Area", FromConversion="SquareMillimeter", ToConversion="SquareMeter")

# group: HORIZONTÁLNÍ PLOCHY - PODLAHY M2
area_2 = Surface.Area(surface=code_block_9)
flatten_2 = List.Flatten(list=area_2)
sum_2 = Math.Sum(values=flatten_2)
convert_between_units_3 = DynamoConvert(sum_2, MeasurementType="Area", FromConversion="SquareMillimeter", ToConversion="SquareMeter")

# group: OBÁLKA M2
bySolid_2 = PolySurface.BySolid(solid=code_block)
area_3 = Surface.Area(surface=bySolid_2)
flatten_3 = List.Flatten(list=area_3)
sum_3 = Math.Sum(values=flatten_3)
convert_between_units_4 = DynamoConvert(sum_3, MeasurementType="Area", FromConversion="SquareMillimeter", ToConversion="SquareMeter")
