# Dynamo graph 2021_04_13-Exterierova_obalka.dyn (Dynamo 2.3.0.5885)

exclude_elements = DSModelElementsSelection()  # 1 picked in the model
getRTD_model = Python(IN[0]=exclude_elements)
# ---------- getRTD_model.python (33 lines) ----------
# -*- coding: utf-8 -*-
# Copyright(c) 2020, Daniel Gercak
#Script for selecting and grouping elements by levels and other parameters for dynamo 
#resource_path: https://github.com/Spaceific-Studio/_WORK/REVIT_API/getRTD_model.py
import sys
import clr
clr.AddReference("RevitServices")
import RevitServices
from RevitServices.Persistence import DocumentManager
doc = DocumentManager.Instance.CurrentDBDocument
pyt_path = r'C:\Program Files (x86)\IronPython 2.7\Lib'
lib_path = r'H:\_WORK\PYTHON\REVIT_API\LIB'
sys.path.append(pyt_path)
sys.path.append(lib_path)

# from itertools import chain, groupby
# from RevitSelection import *
# import RevitSelection as RevitSelection
# from ListUtils import *
# import ListUtils as ListUtils

from Analyse import RTD_model
#from AnalyseForm import *
from Errors import *

rtdObject = RTD_model(doc, IN[0])

if Errors.hasError():
 	OUT = Errors.report
# elif Errors.hasContent():
# 	OUT = Errors.getConntainerContent()
else:
	OUT = rtdObject
# ----------------------------------------
getEnergyAnalyses = Python(IN[0]=getRTD_model)
# ---------- getEnergyAnalyses.python (45 lines) ----------
# -*- coding: utf-8 -*-
# Copyright(c) 2020, Daniel Gercak
#Script for selecting and grouping elements by levels and other parameters for dynamo 
#resource_path: H:\_WORK\PYTHON\REVIT_API\getEnergyAnalyses.py

import sys
pyt_path = r'C:\Program Files (x86)\IronPython 2.7\Lib'
lib_path = r'H:\_WORK\PYTHON\REVIT_API\LIB'
sys.path.append(pyt_path)
sys.path.append(lib_path)

from Analyse import *
from AnalyseForm import *
from Errors import *

clr.AddReference("System.Windows.Forms")
clr.AddReference("System.Drawing")
import System.Drawing
import System.Windows.Forms
from System.Drawing import *
from System.Windows.Forms import Application, Button, Form, ComboBox, Label, TextBox, DockStyle, AnchorStyles, FormBorderStyle



energyAnalyseObject = EnAnalyse(doc, IN[0])
#Errors.catchVar(energyAnalyseObject.quantities, "energyAnalyseObject.quantities", front=True )

# <Run the form window
Application.EnableVisualStyles()
appWindow = MainForm(energyAnalyseObject)
appWindow.FormBorderStyle = FormBorderStyle.FixedSingle
appWindow.TopMost = True
appWindow.BackColor = Color.White


Application.Run(appWindow)

myOutput = "Vážení pŕátelé ANO"

if Errors.hasError():
 	OUT = Errors.report
elif Errors.hasContent():
 	OUT = Errors.getConntainerContent()
else:
	OUT = myOutput
# ----------------------------------------

# group: OUTERSHELLS
string = StringInput("""rtdModel = IN[0]
OUT = rtdModel.outerShells""")
outerShells = PythonStringNode(script=string, IN[0]=getRTD_model)  # "rtdModel.outerShells"
code_block = CodeBlock(obj=outerShells) { obj[0]; }

# group: cutting cube
byGeometry = BoundingBox.ByGeometry(geom=code_block)
minPoint = BoundingBox.MinPoint(boundingBox=byGeometry)
maxPoint = BoundingBox.MaxPoint(boundingBox=byGeometry)
xmin_offset = DoubleSlider(0, range=0..1 step 0.01)
xmax_offset = DoubleSlider(0, range=0..1 step 0.01)
ymin_offset = DoubleSlider(0, range=0..1 step 0.01)
ymax_offset = DoubleSlider(0, range=0..1 step 0.01)
code_block_2 = CodeBlock(inPointMin=minPoint, inPointMax=maxPoint, xMinOffset=xmin_offset, xMaxOffset=xmax_offset, yMinOffset=ymin_offset, yMaxOffset=ymax_offset)
# ---------- code_block_2.designscript (12 lines) ----------
inPointMin.X;
inPointMin.Y;
inPointMin.Z;
inPointMax.X;
inPointMax.Y;
inPointMax.Z;
xLength=inPointMax.X - inPointMin.X;
newLengthX = xLength * (1-Math.Max(xMinOffset+xMaxOffset,1));
yLength=inPointMax.Y - inPointMin.Y;
newLengthY = yLength * (1-Math.Max(yMinOffset+yMaxOffset,1));
newPointMin = Point.ByCoordinates(inPointMin.X+xMinOffset*xLength, inPointMin.Y+yMinOffset*yLength , inPointMin.Z);
newPointMax = Point.ByCoordinates(inPointMax.X-xMaxOffset*xLength, inPointMax.Y-yMaxOffset*yLength , inPointMax.Z);
# ----------------------------------------
byCorners = BoundingBox.ByCorners(min=code_block_2.newPointMin, max=code_block_2.newPointMax)
toCuboid = BoundingBox.ToCuboid(boundingBox=byCorners)
intersect = Geometry.Intersect(geometry=code_block, other=toCuboid)
code_block_3 = CodeBlock { 100; }
code_block_4 = CodeBlock { 150; 255; 50; }
byARGB = Color.ByARGB(a=code_block_3, r=code_block_4.out0, g=code_block_4.out1, b=code_block_4.out2)
byGeometryColor = Modifiers.GeometryColor.ByGeometryColor(geometry=intersect, color=byARGB)
watch = Watch(code_block_2.xLength)
zmin_offset = DoubleSlider(0, range=0..1 step 0.01)
zmax_offset = DoubleSlider(0, range=0..1 step 0.01)

dir = Python(IN[0]=getRTD_model)
# ---------- dir.python (28 lines) ----------
# -*- coding: utf-8 -*-
# Copyright(c) 2020, Daniel Gercak
#Script for selecting and grouping elements by levels and other parameters for dynamo 
#resource_path: H:\_WORK\PYTHON\REVIT_API\getRTD_model.py

import sys
pyt_path = r'C:\Program Files (x86)\IronPython 2.7\Lib'
lib_path = r'H:\_WORK\PYTHON\REVIT_API\LIB'
sys.path.append(pyt_path)
sys.path.append(lib_path)


# from itertools import chain, groupby
# from RevitSelection import *
# import RevitSelection as RevitSelection
# from ListUtils import *
# import ListUtils as ListUtils

from Errors import *



if Errors.hasError():
 	OUT = Errors.report
# elif Errors.hasContent():
# 	OUT = Errors.getConntainerContent()
else:
	OUT = dir(IN[0])
# ----------------------------------------

# group: INNERSHELLS
string_2 = StringInput("""rtdModel = IN[0]
OUT = rtdModel.innerShells""")
innerShells = PythonStringNode(script=string_2, IN[0]=getRTD_model)  # "rtdModel.innerShells"
code_block_5 = CodeBlock(inSolids=innerShells) { inSolids[0]; }
volume = Solid.Volume(solid=code_block_5)
convert_between_units = DynamoConvert(volume, MeasurementType="Volume", FromConversion="CubicMillimeter", ToConversion="CubicMeters")
code_block_6 = CodeBlock { 0.005; }
gt = convert_between_units > code_block_6
filterByBoolMask = List.FilterByBoolMask(list=code_block_5, mask=gt)
integer_slider = IntegerSlider(0, range=0..13 step 1)
getItemAtIndex = List.GetItemAtIndex(list=filterByBoolMask.in, index=integer_slider)  # frozen
bySolid = PolySurface.BySolid(solid=filterByBoolMask.in)
surfaces = PolySurface.Surfaces(polySurface=bySolid)
code_block_7 = CodeBlock { 0.5; }
normalAtParameter = Surface.NormalAtParameter(surface=surfaces, u=code_block_7, v=code_block_7)

# group: HORIZONTÁLNÍ PLOCHY - PODLAHY
Z = Vector.Z(vector=normalAtParameter)
code_block_8 = CodeBlock { -0.8; }
lt = Z < code_block_8
filterByBoolMask_2 = List.FilterByBoolMask(list=surfaces, mask=lt)
code_block_9 = CodeBlock(horizontal=filterByBoolMask_2.in) { horizontal; }
code_block_10 = CodeBlock { 255; }
code_block_11 = CodeBlock { 250; 0; 230; }

byARGB_2 = Color.ByARGB(a=code_block_10, r=code_block_11.out0, g=code_block_11.out1, b=code_block_11.out2)

# group (continued): HORIZONTÁLNÍ PLOCHY - PODLAHY
byGeometryColor_2 = Modifiers.GeometryColor.ByGeometryColor(geometry=code_block_9, color=byARGB_2)

code_block_12 = CodeBlock { 255; }

# group: VERTIKÁLNÍ PLOCHY
Z_2 = Vector.Z(vector=normalAtParameter)
code_block_13 = CodeBlock { 0; }
eq = Z_2 == code_block_13
filterByBoolMask_3 = List.FilterByBoolMask(list=surfaces, mask=eq)
code_block_14 = CodeBlock(vertical=filterByBoolMask_3.in) { vertical; }
code_block_15 = CodeBlock { 20; 0; 200; }
byARGB_3 = Color.ByARGB(a=code_block_12, r=code_block_15.out0, g=code_block_15.out1, b=code_block_15.out2)
byGeometryColor_3 = Modifiers.GeometryColor.ByGeometryColor(geometry=code_block_14, color=byARGB_3)

# group: OPENINGS
string_3 = StringInput("""rtdModel = IN[0]
OUT = rtdModel.subtractedOpenings""")
outerShells_2 = PythonStringNode(script=string_3, IN[0]=getRTD_model)  # "rtdModel.outerShells"
code_block_16 = CodeBlock { 255; }
code_block_17 = CodeBlock { 255; 0; 0; }
byARGB_4 = Color.ByARGB(a=code_block_16, r=code_block_17.out0, g=code_block_17.out1, b=code_block_17.out2)
byGeometryColor_4 = Modifiers.GeometryColor.ByGeometryColor(geometry=outerShells_2, color=byARGB_4)

# group: VERTIKALNI PLOCHY M2
area = Surface.Area(surface=code_block_14)
flatten = List.Flatten(list=area)
sum = Math.Sum(values=flatten)
convert_between_units_2 = DynamoConvert(sum, MeasurementType="Area", FromConversion="SquareMillimeter", ToConversion="SquareMeter")

# group: HORIZONTÁLNÍ PLOCHY - PODLAHY M2
area_2 = Surface.Area(surface=code_block_9)
flatten_2 = List.Flatten(list=area_2)
sum_2 = Math.Sum(values=flatten_2)
convert_between_units_3 = DynamoConvert(sum_2, MeasurementType="Area", FromConversion="SquareMillimeter", ToConversion="SquareMeter")

# group: OBÁLKA M2
bySolid_2 = PolySurface.BySolid(solid=code_block)
area_3 = Surface.Area(surface=bySolid_2)
flatten_3 = List.Flatten(list=area_3)
sum_3 = Math.Sum(values=flatten_3)
convert_between_units_4 = DynamoConvert(sum_3, MeasurementType="Area", FromConversion="SquareMillimeter", ToConversion="SquareMeter")

# group: structuredElements
string_4 = StringInput("# -*- coding: utf-8 -*-\n# Copyright(c) 2020, Daniel Gercak\n#Classes for organizing elements in space and for space analases\n#e.g. kD_Trees...\n#resource_path: https://github.com/Spaceific-Arch/_WORK/REVIT_API/joinStructuredElements.py\nimport sys\nif \"IronPython\" in sys.prefix:\n\tpytPath = r'C:\\Program Files (x86)\\IronPython 2.7\\Lib'\n\tsys.path.append(pytPath)\nimport os\nimport platform\n\ntry:\n\tsys.modules['__main__']\n\thasMainAttr = True\t\nexcept:\n\thasMainAttr = False\n\nif hasMainAttr:\n\t#import clr\n\tif \"pydroid\" in sys.prefix:\n\t    pass\n\telif \"Python38\" in sys.prefix:\n\t    pass\n\telse:\n\t    from Autodesk.Revit.UI.Selection import *\n\t    import Autodesk.Revit.DB as DB\n\t    doc = __revit__.ActiveUIDocument.Document\n\t    #clr.AddReference(\"RevitServices\")\n\t    #import RevitServices\n\t    #from RevitServices.Transactions import TransactionManager\n\t    pass\n\nelse:\n\tif \"pydroid\" in sys.prefix:\n\t    pass\n\telif \"Python38\" in sys.prefix:\n\t    pass\n\telse:\n\t    import clr\n\t    clr.AddReference('ProtoGeometry')\n\t    from Autodesk.DesignScript.Geometry import *\n\t    clr.AddReference(\"RevitAPI\")\n\t    import Autodesk\n\t    import Autodesk.Revit.DB as DB\n\t    clr.AddReference(\"RevitServices\")\n\t    import RevitServices\n\t    from RevitServices.Persistence import DocumentManager\n\t    from RevitServices.Transactions import TransactionManager\n\t    doc = DocumentManager.Instance.CurrentDBDocument\n\n# clr.AddReference(\"RevitAPI\")\n# import Autodesk\n# import Autodesk.Revit.DB as DB\n\ntry:\n\timport Autodesk\n\tsys.modules['Autodesk']\n\thasAutodesk = True\t\nexcept:\n\thasAutodesk = False\n\nprint(\"module : {0} ; hasMainAttr = {1}\".format(__file__, hasMainAttr))\nprint(\"module : {0} ; hasAutodesk = {1}\".format(__file__, hasAutodesk))\n\nif sys.platform.startswith('linux'):\n    libPath = r\"/storage/emulated/0/_WORK/REVIT_API/LIB\"\nelif sys.platform.startswith('win') or sys.platform.startswith('cli'):\n    libPath = r\"H:/_WORK/PYTHON/REVIT_API/LIB\"\n\nif sys.platform.startswith('linux'):\n    pythLibPath = r\"/storage/emulated/0/_WORK/LIB\"\nelif sys.platform.startswith('win') or sys.platform.startswith('cli'):\n    pythLibPath = r\"H:/_WORK/PYTHON/LIB\"\n\nsys.path.append(libPath)\nsys.path.append(pythLibPath)\n\nfrom Errors import *\n\n\"\"\" Errors.catchVar(sys.platform, \"sys.platform\")\nErrors.catchVar(sys.prefix, \"sys.prefix\")\nErrors.catchVar(os.name, \"os.name\")\nErrors.catchVar(platform.sys, \"platform.sys\")\nErrors.catchVar(platform.os, \"platform.os\")\nErrors.catchVar(platform.platform(), \"platform.platform()\") \"\"\"\n\nimport SpaceOrganize\nimport RevitSelection as RS\nimport ListUtils\n\nstructuredElements = IN[0]\nbPoints = []\nbbs = []\nintersectedElements = []\nintersectedSolids = []\nrevitGeos = []\n#TransactionManager.Instance.EnsureInTransaction(doc)\n#t = DB.SubTransaction(doc)\n\n# Begin new transaction\n#t.Start()\nfor i, el in enumerate(list(structuredElements[1])):\n\t\n\t#raise TypeError(\"{0}\".format(type(DB.ElementId(el.Id))))\n\t#Errors.catchVar(el.Id, \"{1} el.Id - {0}\".format(el.Id, i))\n\tdocEl = doc.GetElement(DB.ElementId(el.Id))\n\ttry:\n\t\trevitGeo = RS.getRevitGeometry(el)\n\texcept Exception as ex:\n\t\tErrors.catch(ex, \"Error in getRevitGeo(docEl) dir(el){0}\\ndir(docEl){1}\".format(dir(el), dir(docEl)))\n\t\trevitGeo = None\n\trevitGeos.append(revitGeo)\n\telIntFilter = \tDB.ElementIntersectsElementFilter(docEl)\n\t#reference = DB.Reference(docEl)\n\t#solid = docEl.GetGeometryObjectFromReference(reference)\n\tsolidIntFilter = DB.ElementIntersectsSolidFilter(revitGeo)\n\tintElements = DB.FilteredElementCollector(doc).WherePasses(elIntFilter).WhereElementIsNotElementType().ToElements()\n\tintSolids = DB.FilteredElementCollector(doc).WherePasses(solidIntFilter).WhereElementIsNotElementType().ToElements()\n\tintersectedElements.append(intElements)\n\tintersectedSolids.append(intSolids)\n\t# Get the Bounding Box of the selected element.\n\tel_bb = docEl.get_BoundingBox(doc.ActiveView)\n\tbbs.append(docEl)\n\t#Errors.catchVar(el_bb, \"{1} dir(el.Geometry) - {0}\".format(dir(el.Geometry[options]), i))\n\t#Errors.catchVar(el_bb.Max.X, \"{1} el_bb.Max.X - {0}\".format(el_bb.Max.X, i))\n\tbPoint = ( \\\n\t\t\t\tDB.UnitUtils.ConvertFromInternalUnits((el_bb.Max.X - el_bb.Min.X) / 2.0, DB.DisplayUnitType.DUT_MILLIMETERS), \\\n\t\t\t\tDB.UnitUtils.ConvertFromInternalUnits((el_bb.Max.Y - el_bb.Min.Y) / 2.0, DB.DisplayUnitType.DUT_MILLIMETERS), \\\n\t\t\t\tDB.UnitUtils.ConvertFromInternalUnits((el_bb.Max.Z - el_bb.Min.Z) / 2.0, DB.DisplayUnitType.DUT_MILLIMETERS) \\\n\t\t\t)\n\tbPoints.append(bPoint)\n\n# Close the transaction\n#t.Commit()\n#TransactionManager.Instance.TransactionTaskDone()\n\nif Errors.hasError():\n \tOUT = Errors.report\nelif Errors.hasContent():\n\tOUT = Errors.getConntainerContent()\nelse:\n\tOUT = (structuredElements[1], bPoints, bbs, intersectedElements, intersectedSolids, revitGeos)\n\n\n\n\n")
string_5 = StringInput("""rtdModel = IN[0]
OUT = rtdModel.structuredElements""")
structuredElements = PythonStringNode(script=string_5, IN[0]=getRTD_model)
joinStructuredElements = PythonStringNode(script=string_4, IN[0]=structuredElements)
code_block_18 = CodeBlock(inList=joinStructuredElements) { tList = List.Transpose(inList[1]); tList[0]; tList[1]; tList[2]; }
byCoordinates = Point.ByCoordinates(x=code_block_18.out1, y=code_block_18.out2, z=code_block_18.out3)

code_block_19 = CodeBlock(inList=joinStructuredElements) { tList = inList[0]; }
radius = Arc.Radius()  # unwired: arc
geometry = Element.Geometry()  # unwired: element
flatten_4 = List.Flatten(list=geometry@@L2)
distanceTo = Geometry.DistanceTo(geometry=flatten_4, other=flatten_4, lacing=CrossProduct)
intersectAll = Geometry.IntersectAll()  # unwired: geometry, others
doesIntersect = Geometry.DoesIntersect(geometry=flatten_4, other=flatten_4, lacing=CrossProduct)
code_block_20 = CodeBlock(inList=joinStructuredElements) { tList = inList[4]; }
geometry_2 = Element.Geometry(element=code_block_20)

# group: structuredElements
string_6 = StringInput("# -*- coding: utf-8 -*-\n# Copyright(c) 2020, Daniel Gercak\n#Classes for organizing elements in space and for space analases\n#e.g. kD_Trees...\n#resource_path: https://github.com/Spaceific-Arch/_WORK/REVIT_API/joinStructuredElements.py\nimport sys\nif \"IronPython\" in sys.prefix:\n\tpytPath = r'C:\\Program Files (x86)\\IronPython 2.7\\Lib'\n\tsys.path.append(pytPath)\nimport os\nimport platform\n\ntry:\n\tsys.modules['__main__']\n\thasMainAttr = True\t\nexcept:\n\thasMainAttr = False\n\nif hasMainAttr:\n\t#import clr\n\tif \"pydroid\" in sys.prefix:\n\t    pass\n\telif \"Python38\" in sys.prefix:\n\t    pass\n\telse:\n\t    from Autodesk.Revit.UI.Selection import *\n\t    import Autodesk.Revit.DB as DB\n\t    doc = __revit__.ActiveUIDocument.Document\n\t    #clr.AddReference(\"RevitServices\")\n\t    #import RevitServices\n\t    #from RevitServices.Transactions import TransactionManager\n\t    pass\n\nelse:\n\tif \"pydroid\" in sys.prefix:\n\t    pass\n\telif \"Python38\" in sys.prefix:\n\t    pass\n\telse:\n\t    import clr\n\t    clr.AddReference('ProtoGeometry')\n\t    from Autodesk.DesignScript.Geometry import *\n\t    clr.AddReference(\"RevitAPI\")\n\t    import Autodesk\n\t    import Autodesk.Revit.DB as DB\n\t    clr.AddReference(\"RevitServices\")\n\t    import RevitServices\n\t    from RevitServices.Persistence import DocumentManager\n\t    from RevitServices.Transactions import TransactionManager\n\t    doc = DocumentManager.Instance.CurrentDBDocument\n\n# clr.AddReference(\"RevitAPI\")\n# import Autodesk\n# import Autodesk.Revit.DB as DB\n\ntry:\n\timport Autodesk\n\tsys.modules['Autodesk']\n\thasAutodesk = True\t\nexcept:\n\thasAutodesk = False\n\nprint(\"module : {0} ; hasMainAttr = {1}\".format(__file__, hasMainAttr))\nprint(\"module : {0} ; hasAutodesk = {1}\".format(__file__, hasAutodesk))\n\nif sys.platform.startswith('linux'):\n    libPath = r\"/storage/emulated/0/_WORK/REVIT_API/LIB\"\nelif sys.platform.startswith('win') or sys.platform.startswith('cli'):\n    libPath = r\"H:/_WORK/PYTHON/REVIT_API/LIB\"\n\nif sys.platform.startswith('linux'):\n    pythLibPath = r\"/storage/emulated/0/_WORK/LIB\"\nelif sys.platform.startswith('win') or sys.platform.startswith('cli'):\n    pythLibPath = r\"H:/_WORK/PYTHON/LIB\"\n\nsys.path.append(libPath)\nsys.path.append(pythLibPath)\n\nfrom Errors import *\n\n\"\"\" Errors.catchVar(sys.platform, \"sys.platform\")\nErrors.catchVar(sys.prefix, \"sys.prefix\")\nErrors.catchVar(os.name, \"os.name\")\nErrors.catchVar(platform.sys, \"platform.sys\")\nErrors.catchVar(platform.os, \"platform.os\")\nErrors.catchVar(platform.platform(), \"platform.platform()\") \"\"\"\n\nimport SpaceOrganize\nimport RevitSelection as RS\nimport ListUtils\n\nstructuredElements = IN[0]\nbPoints = []\nbbs = []\nintersectedElements = []\nintersectedSolids = []\nrevitGeos = []\n#TransactionManager.Instance.EnsureInTransaction(doc)\n#t = DB.SubTransaction(doc)\n\n# Begin new transaction\n#t.Start()\nfor i, el in enumerate(list(structuredElements[1])):\n\t\n\t#raise TypeError(\"{0}\".format(type(DB.ElementId(el.Id))))\n\t#Errors.catchVar(el.Id, \"{1} el.Id - {0}\".format(el.Id, i))\n\tdocEl = doc.GetElement(DB.ElementId(el.Id))\n\ttry:\n\t\trevitGeo = RS.getRevitGeometry(el)\n\texcept Exception as ex:\n\t\tErrors.catch(ex, \"Error in getRevitGeo(docEl) dir(el){0}\\ndir(docEl){1}\".format(dir(el), dir(docEl)))\n\t\trevitGeo = None\n\trevitGeos.append(revitGeo)\n\telIntFilter = \tDB.ElementIntersectsElementFilter(docEl)\n\t#reference = DB.Reference(docEl)\n\t#solid = docEl.GetGeometryObjectFromReference(reference)\n\tsolidIntFilter = DB.ElementIntersectsSolidFilter(revitGeo)\n\tintElements = DB.FilteredElementCollector(doc).WherePasses(elIntFilter).WhereElementIsNotElementType().ToElements()\n\tintSolids = DB.FilteredElementCollector(doc).WherePasses(solidIntFilter).WhereElementIsNotElementType().ToElements()\n\tintersectedElements.append(intElements)\n\tintersectedSolids.append(intSolids)\n\t# Get the Bounding Box of the selected element.\n\tel_bb = docEl.get_BoundingBox(doc.ActiveView)\n\tbbs.append(docEl)\n\t#Errors.catchVar(el_bb, \"{1} dir(el.Geometry) - {0}\".format(dir(el.Geometry[options]), i))\n\t#Errors.catchVar(el_bb.Max.X, \"{1} el_bb.Max.X - {0}\".format(el_bb.Max.X, i))\n\tbPoint = ( \\\n\t\t\t\tDB.UnitUtils.ConvertFromInternalUnits((el_bb.Max.X - el_bb.Min.X) / 2.0, DB.DisplayUnitType.DUT_MILLIMETERS), \\\n\t\t\t\tDB.UnitUtils.ConvertFromInternalUnits((el_bb.Max.Y - el_bb.Min.Y) / 2.0, DB.DisplayUnitType.DUT_MILLIMETERS), \\\n\t\t\t\tDB.UnitUtils.ConvertFromInternalUnits((el_bb.Max.Z - el_bb.Min.Z) / 2.0, DB.DisplayUnitType.DUT_MILLIMETERS) \\\n\t\t\t)\n\tbPoints.append(bPoint)\n\n# Close the transaction\n#t.Commit()\n#TransactionManager.Instance.TransactionTaskDone()\n\nif Errors.hasError():\n \tOUT = Errors.report\nelif Errors.hasContent():\n\tOUT = Errors.getConntainerContent()\nelse:\n\tOUT = (structuredElements[1], bPoints, bbs, intersectedElements, intersectedSolids, revitGeos)\n\n\n\n\n")
string_7 = StringInput("""rtdModel = IN[0]
OUT = rtdModel.structuredElements""")
structuredElements_2 = PythonStringNode(script=string_7, IN[0]=getRTD_model)
joinStructuredElements_2 = PythonStringNode(script=string_6, IN[0]=structuredElements_2)
code_block_21 = CodeBlock(inList=joinStructuredElements_2) { tList = List.Transpose(inList[1]); tList[0]; tList[1]; tList[2]; }
byCoordinates_2 = Point.ByCoordinates(x=code_block_21.out1, y=code_block_21.out2, z=code_block_21.out3)

string_8 = StringInput("""rtdModel = IN[0]
OUT = rtdModel.dynamoSolids""")
structuredElements_3 = PythonStringNode(script=string_8, IN[0]=getRTD_model)
string_9 = StringInput("""rtdModel = IN[0]
OUT = rtdModel.timeRecord""")
structuredElements_4 = PythonStringNode(script=string_9, IN[0]=getRTD_model)
