# Dynamo graph 2021_04_30-RTD_model-raw.dyn (Dynamo 2.3.0.5885)

code_block = CodeBlock { "OUT=IN[0].timeRecord"; }
getRTD_model = Python()  # unwired: IN[0]
# ---------- getRTD_model.python (34 lines) ----------
# -*- coding: utf-8 -*-
# Copyright(c) 2020, Daniel Gercak
#Script for selecting and grouping elements by levels and other parameters for dynamo 
#resource_path: https://github.com/Spaceific-Studio/_WORK/REVIT_API/getRTD_model.py

import sys
import clr
clr.AddReference("RevitServices")
import RevitServices
from RevitServices.Persistence import DocumentManager
doc = DocumentManager.Instance.CurrentDBDocument
pyt_path = r'C:\Program Files (x86)\IronPython 2.7\Lib'
lib_path = r'H:\_WORK\PYTHON\REVIT_API\LIB'
sys.path.append(pyt_path)
sys.path.append(lib_path)

# from itertools import chain, groupby
# from RevitSelection import *
# import RevitSelection as RevitSelection
# from ListUtils import *
# import ListUtils as ListUtils

from Analyse import RTD_model
#from AnalyseForm import *
from Errors import *

rtdObject = RTD_model(doc, IN[0])

if Errors.hasError():
 	OUT = Errors.report
# elif Errors.hasContent():
# 	OUT = Errors.getConntainerContent()
else:
	OUT = rtdObject
# ----------------------------------------
python_script_from_string = PythonStringNode(script=code_block, IN[0]=getRTD_model)
code_block_2 = CodeBlock { "OUT=IN[0].structuredElements"; }
python_script_from_string_2 = PythonStringNode(script=code_block_2, IN[0]=getRTD_model)
code_block_3 = CodeBlock { "OUT=IN[0].dynamoSolids"; }
python_script_from_string_3 = PythonStringNode(script=code_block_3, IN[0]=getRTD_model)
code_block_4 = CodeBlock(inList=python_script_from_string_3) { inList[5]; }
revit_3DView_to_Dynamo = Custom[Revit_3DView_to_Dynamo]()  # Converts Revit model in current 3D view to dynamo geometry for building envelope analyse purpose. It exludes all elements except these categories: Floors, Roofs, Walls, Curtain-Walls (as simple solid), Structural frames and columns.; unwired: exclude_elements
watch = Watch(revit_3DView_to_Dynamo.dynamoSolids)
code_block_5 = CodeBlock(ins=revit_3DView_to_Dynamo.structuredElements) { Type ins[0]; }
type = Object.Type(obj=revit_3DView_to_Dynamo.structuredElements)
watch_2 = Watch()  # unwired: arg0
