# Dynamo graph A_V-factor.dyn (Dynamo 1.3.1.1736)

categories = Categories("Floors")
all_elements_of_category = ElementsOfCategory(categories)
categories_2 = Categories("Windows")
all_elements_of_category_2 = ElementsOfCategory(categories_2)
categories_3 = Categories("Doors")
all_elements_of_category_3 = ElementsOfCategory(categories_3)
curves = Element.Curves()  # unwired: arg0
custom = Custom[]()
categories_4 = Categories("Walls")
all_elements_of_category_4 = ElementsOfCategory(categories_4)
faces = Element.Faces(all_elements_of_category_4)
