# Dynamo graph WallExteriorFaces.dyn (Dynamo 1.3.1.1736)

seleccionar_elementos = DSModelElementsSelection()  # 98 picked in the model
code_block = CodeBlock { "Wall"; }
removeIfNot = RemoveIfNot(seleccionar_elementos, code_block)
code_block_2 = CodeBlock { "Base Constraint"; }
getParameterValueByName = Element.GetParameterValueByName(element=removeIfNot, parameterName=code_block_2)
groupByKey = List.GroupByKey(list=removeIfNot, keys=getParameterValueByName)
geometry = Element.Geometry(groupByKey.groups)
flatten = Flatten(geometry, lacing=Longest)
byUnion = Solid.ByUnion(flatten)
explode = Geometry.Explode(byUnion)
categories = Categories("Rooms")
all_elements_of_category = ElementsOfCategory(categories)
code_block_3 = CodeBlock { "Level"; }
getParameterValueByName_2 = Element.GetParameterValueByName(element=all_elements_of_category, parameterName=code_block_3)
groupByKey_2 = List.GroupByKey(list=all_elements_of_category, keys=getParameterValueByName_2)
geometry_2 = Element.Geometry(groupByKey_2.groups)
flatten_2 = Flatten(geometry_2, lacing=Longest)
byUnion_2 = Solid.ByUnion(flatten_2)
doesIntersect = Geometry.DoesIntersect(geometry=explode, other=byUnion_2)
code_block_4 = CodeBlock(list=doesIntersect) { List.AllIndicesOf(list<1>, false); }
code_block_5 = CodeBlock(list=explode, index=code_block_4) { List.GetItemAtIndex(list<1>, index<1>); }
code_block_6 = CodeBlock { "Floor"; }
removeIfNot_2 = RemoveIfNot(seleccionar_elementos, code_block_6)
getParameterValueByName_3 = Element.GetParameterValueByName()  # unwired: element, parameterName
exteriorDirection = Custom[Wall.ExteriorDirection](Wall=removeIfNot)  # This node returns exterior direction of the wall as a vector.
getLocation = Element.GetLocation(removeIfNot)
image_resolution = ImageResolutionUi("DPI_300")
