# Dynamo graph divide_parts_by_area_boundary.dyn (Dynamo 1.3.2.2480)

divideParts = RevitElements.Parts.DivideParts()  # frozen; unwired: arg0, arg1

# group: Collect all Elements of One Category at Level
levels = Levels("Level 1")
all_elements_at_level = ElementsAtLevel(levels)
categories = Categories("Floors")
isOfCategory = Custom[Element.IsOfCategory](element=all_elements_at_level, category=categories)  # Checks whether an element is of a specified category
filterByBoolMask = List.FilterByBoolMask(list=all_elements_at_level, mask=isOfCategory)

# group: Collect Areas (Elements and Boundary curves)
categories_2 = Categories("Areas")
all_elements_of_category = ElementsOfCategory(categories_2)
boundaries = Custom[Room.Boundaries](area=all_elements_of_category)  # Gets a list of all boundary elements of a given room or area

curves = Custom[Divide Parts By Area Boundary Lines](myWholeParts=filterByBoolMask.in, InputAreaBoundaryLine=boundaries.elements, DivideSketchPlane=levels)  # "AreaBoundary.Curves"; Divide Parts By Area Boundary Lines
