# Dynamo graph wall end join example.dyn (Dynamo 2.0.1.5055)

categories = Categories(index=574)  # graph input
all_elements_of_category = ElementsOfCategory(Category=categories)
code_block = CodeBlock { 2; }
combinations = List.Combinations(list=all_elements_of_category, length=code_block)
getLocation = Element.GetLocation(element=combinations)
transpose = List.Transpose(lists=getLocation)
code_block_2 = CodeBlock(list=transpose) { list[0]; list[1]; }
intersect = Geometry.Intersect(geometry=code_block_2.out0, other=code_block_2.out1)
isEmpty = List.IsEmpty(list=intersect@L2)
filterByBoolMask = List.FilterByBoolMask(list=combinations, mask=isEmpty)
watch = Watch(filterByBoolMask.out)
