# Dynamo graph wall end join example2.dyn "wall end join example" (Dynamo 2.0.1.5055)

categories = Categories(index=574)  # graph input
all_elements_of_category = ElementsOfCategory(Category=categories)
code_block = CodeBlock { 2; }
combinations = List.Combinations(list=all_elements_of_category, length=code_block)  # frozen
getLocation = Element.GetLocation(element=combinations)
transpose = List.Transpose(lists=getLocation)
code_block_2 = CodeBlock(list=transpose) { list[0]; list[1]; }
intersect = Geometry.Intersect(geometry=code_block_2.out0, other=code_block_2.out1)
isEmpty = List.IsEmpty(list=intersect@L2)
filterByBoolMask = List.FilterByBoolMask(list=combinations, mask=isEmpty)
watch = Watch(filterByBoolMask.out)
python_script = Python(IN[0]=all_elements_of_category)
# ---------- python_script.python (39 lines) ----------
import clr
clr.AddReference("ProtoGeometry")
from Autodesk.DesignScript.Geometry import *
# Import RevitAPI
clr.AddReference("RevitAPI")
from Autodesk.Revit.DB import *
clr.AddReference("RevitAPIUI")
from Autodesk.Revit.UI import TaskDialog
# Import DocumentManager and TransactionManager
clr.AddReference("RevitServices")
from RevitServices.Persistence import DocumentManager
from RevitServices.Transactions import TransactionManager
# Import ToProtoType, ToRevitType geometry conversion extension methods
clr.AddReference("RevitNodes")
import Revit
clr.ImportExtensions(Revit.GeometryConversion)

doc = DocumentManager.Instance.CurrentDBDocument
uiapp = DocumentManager.Instance.CurrentUIApplication
app = uiapp.Application

dataEnteringNode = IN
walls = []
for i in IN[0]:
	walls.append(UnwrapElement(i))
	
intcurves = []
for w in walls:
	intcurves.append(w.Location.Curve.ToProtoType())
	
int1 = []
int2 = []
for i in range(len(intcurves)-1):
	for j in range(i+1, len(intcurves)):
			if intcurves[i].DoesIntersect(intcurves[j]):
				int1.append(i)
				int2.append(j)

OUT = int1, int2
# ----------------------------------------
getItemAtIndex = List.GetItemAtIndex(list=all_elements_of_category, index=python_script)
transpose_2 = List.Transpose(lists=getItemAtIndex)
